# Dynamo graph Creating_Duplicate_Views.dyn "04 Duplicate View" (Dynamo 2.6.1.8786)
# packages: Synthetic 2.0.200209, Clockwork for Dynamo 1.x 1.34.0

# group: Total Views to be created and their count
no_of_views_to_be_created = DoubleInput(1)  # graph input
count = List.Count(list=no_of_views_to_be_created)

# group: Fetching data from Active View
activeView = Synthetic.Revit.View.ActiveView()
watch = Watch(activeView)
name = Synthetic.Revit.Elements.Name(Element=watch)
string_from_object = FromObject(obj=name)

# group: Renaming the views according to Parent View
cycle = List.Cycle(list=activeView, amount=no_of_views_to_be_created)
getKeys = GetKeys(list=cycle)
number = DoubleInput(1)
add = getKeys + number
add_2 = string_from_object + add
string_from_object_2 = FromObject(obj=add_2)

# group: Creating Duplicate with Detailing Views
duplicateWithDetailing = Custom[View.DuplicateWithDetailing](view=cycle, name=string_from_object_2)  # package Clockwork for Dynamo 1.x; Duplicates a given view with detailing
